vi "Send Message.gvi"   [LabVIEW NXG 3.1.0]
inputs:
  "Message Queue In": Queue<"Message.gtype">
  "Message Data": variant
  "error in": error
  "Message in": "Message.gtype"
outputs:
  "Message Queue Out": Queue<"Message.gtype">
  "error out": error
uses:
  Actor Framework::Primitives::Message.gtype::Write Message Data.gvi
diagram:
  call "Write Message Data.gvi"(Message in=$"Message in", Message Data=$"Message Data", error in=$"error in") -> (Message out=w1, error out=w2)
  Enqueue Element(element=w1, error in=w2, queue=$"Message Queue In") -> (error out=w3, queue out=w4)
  $"Message Queue Out" <- w4
  $"error out" <- w3
