vi "Actor Launcher.gvi"   [LabVIEW NXG 3.1.0]
inputs:
  "Nested Actor In": "Actor.gtype"
  "error in": error
  "Caller Actor In": "Actor.gtype"
outputs:
  "Actor Enqueuer": Queue<"Message.gtype">
  "error out": error
  "Caller Actor Out": "Actor.gtype"
uses:
  Actor Framework::Primitives::Actor.gtype::Read Self Enqueuer.gvi
  Actor Framework::Primitives::Actor.gtype::Add Called Actor Queue.gvi
diagram:
  Obtain Queue(element data type=Queue<"Message.gtype"> constant, error in=$"error in") -> (error out=w1, queue out=w2)
  case (w1) {
    frame Error, Default {
      w3 = w1
      w4 = w2
      w5 = default
      w6 = $"Caller Actor In"
    }
    frame No Error {
      call "Read Self Enqueuer.gvi"(Actor in=$"Caller Actor In", error in=w1) -> (Actor out=w7, Self Enqueuer=w8, error out=w9)
      Open VI Reference[CallOptions=AsynchronousCallWithoutWait](error in=w9, type specifier VI reference=StrictVIRefnum<"function Actor Wrapper.gvi"> constant, vi name="Actor Framework::Primitives::Actor Wrapper.gvi") -> (error out=w10, vi reference=w11)
      Call By Reference[CallByReferenceLoadType=0, CallByReferenceStyle=1](L0=$"Nested Actor In", L1=w2, L2=w8, L3=w10, error in=w10, #ri=w11) -> (error out=w12, #ro=w13)
      Dequeue Element(error in=w12, queue=w2) -> (element=w5, error out=w14, queue out=w4)
      Close Reference(error in=w14, reference=w13) -> (error out=w15)
      call "Add Called Actor Queue.gvi"(Actor in=w7, Reference Constant=w5, Error in=w15) -> (Actor out=w6, Error out=w3)
    }
  }
  $"Caller Actor Out" <- w6
  Release Queue(error in=w3, queue=w4) -> (error out=w16)
  $"error out" <- w16
  $"Actor Enqueuer" <- w5
