vi "Actor Wrapper.gvi"   [LabVIEW NXG 3.1.0]
inputs:
  "Actor In": "Actor.gtype"
  "Error In": error
  "Caller Queue": Queue<"Message.gtype">
  "Reference Queue": Queue<Queue<"Message.gtype">>
outputs:
  "Actor Out": "Actor.gtype"
  "Error Out": error
uses:
  Actor Framework::Primitives::Actor.gtype::Write Caller Enqueuer.gvi
  Actor Framework::Primitives::Actor.gtype::Write Self Enqueuer.gvi
  Actor Framework::Primitives::Actor.gtype::Actor Init.gvi
  Actor Framework::Primitives::Actor.gtype::Actor Core.gvi
  Actor Framework::Primitives::Actor.gtype::Stop All Called.gvi
  Actor Framework::Primitives::Actor.gtype::Send Last Ack.gvi
  Actor Framework::Primitives::Actor.gtype::Clean up.gvi
diagram:
  case ($"Error In") {
    frame Error, Default {
      w1 = $"Error In"
      w2 = $"Actor In"
    }
    frame No Error {
      call "Write Caller Enqueuer.gvi"(Actor in=$"Actor In", Caller Enqueuer=$"Caller Queue", error in=$"Error In") -> (Actor out=w3, error out=w4)
      Obtain Queue(element data type="Message.gtype" constant, error in=w4) -> (error out=w5, queue out=w6)
      Enqueue Element(element=w6, error in=w5, queue=$"Reference Queue") -> (error out=w7)
      call "Write Self Enqueuer.gvi"(Actor in=w3, Self Enqueuer=w6, error in=w7) -> (Actor out=w8, error out=w9)
      call "Actor Init.gvi"(Actor in=w8, Error in=w9) -> (Actor out=w10, Error out=w11)
      call "Actor Core.gvi"(Actor in=w10, Error in=w11) -> (Actor out=w12, Error out=w13)
      call "Stop All Called.gvi"(Actor in=w12, Error in=w13) -> (Actor out=w14, Error out=w15)
      call "Send Last Ack.gvi"(Actor in=w14, Error in=w15) -> (Actor out=w16, Error out=w17)
      call "Clean up.gvi"(Actor in=w16, Error in=w17) -> (Actor out=w2, Error out=w1)
    }
  }
  $"Actor Out" <- w2
  $"Error Out" <- w1
