vi "Actor Core.gvi"   [LabVIEW NXG 3.1.0]
inputs:
  "Actor in": "Actor.gtype"
  "Error in": error
outputs:
  "Actor out": "Actor.gtype"
  "Error out": error
uses:
  Actor Framework::Primitives::Message.gtype::Read Message Data.gvi
  Actor Framework::Primitives::Message.gtype::Do.gvi
  Actor Framework::Primitives::Actor.gtype::Handle Error.gvi
diagram:
  case ($"Error in") {
    frame No Error {
      while {
        Property Node(instance in=$"Actor in") -> ("Self Enqueuer"=w3, instance out=w4)
        Dequeue Element(error in=$"Error in", queue=w3) -> (element=w5, error out=w6)
        case (w6) {
          frame Error, Default {
            w7 = w6
            w8 = w4
          }
          frame No Error {
            call "Read Message Data.gvi"(Message in=w5, error in=w6) -> (Message out=w9, Message Data=w10, error out=w11)
            call "Do.gvi"(Actor In=w4, Message in=w9, Message Data=w10, Error in=w11) -> (Actor Out=w12, Error out=w13)
            Preserve Run Time Class(error in=w13, object in=w12, target object=w4) -> (error out=w7, object out=w8)
          }
        }
        case (w7) {
          frame No Error {
            w2 = w8
            w1 = w7
            w14 = default
          }
          frame Error {
            call "Handle Error.gvi"(Actor in=w8, Error in=w7) -> (Actor out=w2, Stop Actor=w14, Error out=w1)
          }
        }
        stop if w14
      }
    }
    frame Error {
      w1 = $"Error in"
      w2 = $"Actor in"
    }
  }
  $"Actor out" <- w2
  $"Error out" <- w1
