vi "Add Called Actor Queue.gvi"   [LabVIEW NXG 3.1.0]
inputs:
  "Reference Constant": Queue<"Message.gtype">
  "Actor in": "Actor.gtype", required
  "Error in": error
outputs:
  "Actor out": "Actor.gtype"
  "Error out": error
diagram:
  case ($"Error in") {
    frame No Error {
      in-place (after $"Actor in") {
        Unbundle Bundle Read Poser() -> ("Called Enqueuers"=w3)
        Search 1D Array(1D array=w3, element=$"Reference Constant") -> (index of element=w4)
        case (w4) {
          frame 0.., Default {
            w5 = w3
          }
          frame -1 {
            Build Array(w3, $"Reference Constant") -> w5
          }
        }
        Unbundle Bundle Write Poser("Called Enqueuers"=w5)
        w2 = _
      }
      w1 = $"Error in"
    }
    frame Error {
      w1 = $"Error in"
      w2 = $"Actor in"
    }
  }
  $"Actor out" <- w2
  $"Error out" <- w1
