vi "Clean up.gvi"   [LabVIEW NXG 3.1.0]
inputs:
  "Actor in": "Actor.gtype", required
  "Error in": error
outputs:
  "Actor out": "Actor.gtype"
  "Error out": error
diagram:
  case ($"Error in") {
    frame No Error {
      Property Node(instance in=$"Actor in", error in=$"Error in") -> ("Self Enqueuer"=w3, error out=w4, instance out=w2)
      Release Queue(error in=w4, queue=w3) -> (error out=w1)
    }
    frame Error {
      w1 = $"Error in"
      w2 = $"Actor in"
    }
  }
  $"Actor out" <- w2
  $"Error out" <- w1
