vi "Send Last Ack.gvi"   [LabVIEW NXG 3.1.0]
inputs:
  "Actor in": "Actor.gtype"
  "Error in": error
outputs:
  "Actor out": "Actor.gtype"
  "Error out": error
uses:
  Actor Framework::Functions::Send Message.gvi
diagram:
  case ($"Error in") {
    frame No Error {
      Property Node(instance in=$"Actor in") -> ("Caller Enqueuer"=w3, "Self Enqueuer"=w4, instance out=w2)
      call "Send Message.gvi"(Message Queue In=w3, Message in="Send Last Ack.gtype" constant, Message Data=w4, error in=$"Error in") -> (error out=w1)
    }
    frame Error {
      w1 = $"Error in"
      w2 = $"Actor in"
    }
  }
  $"Actor out" <- w2
  $"Error out" <- w1
