vi "Stop All Called.gvi"   [LabVIEW NXG 3.1.0]
inputs:
  "Actor in": "Actor.gtype", required
  "Error in": error
outputs:
  "Actor out": "Actor.gtype"
  "Error out": error
uses:
  Actor Framework::Functions::Send Stop.gvi
diagram:
  case ($"Error in") {
    frame No Error {
      Property Node(instance in=$"Actor in") -> ("Called Enqueuers"=w3, instance out=w2)
      s1 = $"Error in"  # shift register
      for {
        w4 = each element of w3
        call "Send Stop.gvi"(Message Queue=w4, error in=s1) -> (error out=w5)
        next s1 = w5
      }
      w1 = s1
    }
    frame Error {
      w1 = $"Error in"
      w2 = $"Actor in"
    }
  }
  $"Actor out" <- w2
  $"Error out" <- w1
