vi "Do.gvi"   [LabVIEW NXG 3.1.0]
inputs:
  "Actor In": "Actor.gtype"
  "Send Last Ack in": "Send Last Ack.gtype"
  "Error in": error
  "Message Data": variant
outputs:
  "Actor Out": "Actor.gtype"
  "Send Last Ack out": "Send Last Ack.gtype"
  "Error out": error
uses:
  Actor Framework::Primitives::Actor.gtype::Delete Nested Actor Queue.gvi
diagram:
  case ($"Error in") {
    frame Error, Default {
      w1 = $"Error in"
      w2 = $"Actor In"
      w3 = $"Send Last Ack in"
    }
    frame No Error {
      Variant To Data(error in (no error)=$"Error in", type=Queue<"Message.gtype"> constant, variant=$"Message Data") -> (data=w4, error out=w5)
      call "Delete Nested Actor Queue.gvi"(Actor in=$"Actor In", Message Queue=w4, Error in=w5) -> (Actor out=w2, Error out=w1)
      w3 = $"Send Last Ack in"
    }
  }
  $"Send Last Ack out" <- w3
  $"Actor Out" <- w2
  $"Error out" <- w1
