vi "Do.gvi"   [LabVIEW NXG 3.1.0]
inputs:
  "Actor In": "Actor.gtype"
  "Pop Up in": "Pop Up.gtype"
  "Error in": error
  "Message Data": variant
outputs:
  "Pop Up out": "Pop Up.gtype"
  "Error out": error
  "Actor Out": "Actor.gtype"
panel indicators:
  "Received Message": string
diagram:
  Property Node(instance in=reference to unnamed native front panel, error in=$"Error in") -> ("Window"=w1, error out=w2)
  Open Window(reference in=w1, error in=w2, modal=TRUE) -> (reference out=w3, error out=w4)
  case (w4) {
    frame Error, Default {
      w5 = w4
      w6 = $"Actor In"
      w7 = $"Pop Up in"
      w8 = w3
    }
    frame No Error {
      Variant To Data(error in (no error)=w4, type=string "", variant=$"Message Data") -> (data=w9, error out=w5)
      $"Received Message" <- w9
      Wait(time to wait=5000)
      w6 = $"Actor In"
      w7 = $"Pop Up in"
      w8 = w3
    }
  }
  $"Pop Up out" <- w7
  Open Window(reference in=w8, error in=w5) -> (error out=w10)
  $"Error out" <- w10
  $"Actor Out" <- w6
