vi "Actor Core.gvi"   [LabVIEW NXG 3.1.0]
inputs:
  "Test Child Actor in": "Test Child Actor.gtype"
  "Error in": error
outputs:
  "Test Child Actor out": "Test Child Actor.gtype"
  "Error out": error
uses:
  Actor Framework::Primitives::Actor.gtype::Actor Core.gvi
  Actor Framework::Functions::Caller Enqueuer.gvi
  Actor Framework::Functions::Send Message.gvi
diagram:
  call parent "Actor Core.gvi"(Actor in=$"Test Child Actor in", Error in=$"Error in") -> (Actor out=w1, Error out=w2)
  $"Test Child Actor out" <- w1
  $"Error out" <- w2
  call "Caller Enqueuer.gvi"(Actor in=$"Test Child Actor in", error in=$"Error in") -> (Caller Enqueuer=w3, error out=w4)
  call "Send Message.gvi"(Message Queue In=w3, Message in="Pop Up.gtype" constant, Message Data="Child to Parent message", error in=w4)
