vi "Actor Core.gvi"   [LabVIEW NXG 3.1.0]
inputs:
  "Test Root Child in": "Test Root Child.gtype"
  "Error in": error
outputs:
  "Test Root Child out": "Test Root Child.gtype"
  "Error out": error
panel controls:
  "Stop Actor": bool
  "Stop Loop": bool
uses:
  Actor Framework::Functions::Launch Nested Actor.gvi
  Actor Framework::Primitives::Actor.gtype::Actor Core.gvi
  Actor Framework::Primitives::Actor.gtype::Read Self Enqueuer.gvi
diagram:
  disable {
    frame Disabled {
      w1 = $"Error in"
      w2 = $"Test Root Child in"
    }
    frame Enabled {
      call "Launch Nested Actor.gvi"(Caller Actor In=$"Test Root Child in", Actor In="Test Child Actor.gtype" constant, error in=$"Error in") -> (Caller Actor Out=w2, Actor Enqueuer=w3, error out=w1)
    }
  }
  call parent "Actor Core.gvi"(Actor in=w2, Error in=w1) -> (Actor out=w4, Error out=w5)
  $"Test Root Child out" <- w4
  Property Node(instance in=reference to unnamed native front panel) -> ("Window"=w6)
  Open Window(reference in=w6, error in=w1, modal=TRUE) -> (reference out=w7, error out=w8)
  while {
    event {
      on "Stop Loop" Value changed {
        w9 = TRUE
        w10 = default
        w11 = w7
      }
      on "Stop Actor" Value changed {
        Enqueue Element(element="Stop.gtype" constant, queue=w3)
        call "Read Self Enqueuer.gvi"(Actor in=w2) -> (Self Enqueuer=w12)
        Enqueue Element(element="Stop.gtype" constant, error in=w8, queue=w12) -> (error out=w10)
        w9 = FALSE
        w11 = w7
      }
    }
    stop if w9
  }
  Close Window(reference in=w11, error in=w10) -> (error out=w13)
  Merge Errors(w5, w13) -> (error out=w14)
  $"Error out" <- w14
